# Grasshopper definition SolarGAN_Hops_Template.gh (Grasshopper 1.0.7)
# plug-ins: Hops

brep = Brep(<brep referenced from the Rhino model>)
path = FilePath("C:\Users\phili\Documents\GitHub\SolarGAN\beta_vae_idgan\data\graycube\sg_graycube__11.PNG")
pt = Point(<point referenced from the Rhino model>)
path_2 = FilePath("C:\Users\phili\Documents\GitHub\hive\GrasshopperExamples\Templates\HIVE_Zurich.epw")
image_resource = ImageResource(path)
panel = Panel(path)
brep_cp = BrepClosestPoint(Point=pt, Brep=brep)  # -> Point, Normal, Distance
hops = Hops(
    Path=path,
    CacheResultsInMemory=False,
    CacheSolveResults=False,
    RemoteDefinitionLocation="http://127.0.0.1:5000/att_processing",
    RemoteSolveVersion=(0, 1, 0),
    ShowInput_Enabled=False,
    ShowInput_Path=False,
    SynchronousSolve=True)  # -> C_mu, C_var
pt2num = PointsToNumbers(Points=brep_cp.Normal, Mask=4)
pt2num_2 = PointsToNumbers(Points=brep_cp.Point, Mask=4)
item = ListItem(List=pt2num_2, Index="2", Wrap=True)
item_2 = ListItem(List=pt2num, Index="1", Wrap=True)
item_3 = ListItem(List=pt2num, Index="0", Wrap=True)
panel_2 = Panel(hops.C_mu)
flatten = FlattenTree(Tree=item, Path="{0}")
flatten_2 = FlattenTree(Tree=item_3, Path="{0}")
flatten_3 = FlattenTree(Tree=item_2, Path="{0}")
panel_3 = Panel(flatten)
panel_4 = Panel(flatten_2)
panel_5 = Panel(flatten_3)
button = Button()
hops_2 = Hops(
    Run=Toggle(True),
    EnsembleSize=Slider(100, range=0..100),
    ImageFeatures=panel_2,
    Latitude=Slider(46.25, range=0..90),
    Longitude=Slider(6.13, range=0..180),
    Height=panel_3,
    SurfaceNormalX=panel_4,
    SurfaceNormalY=panel_5,
    MonthlyIndex=Slider(6, range=1..12),
    SolarDeclination=Slider(0.115, range=-1..1),
    EPWFilePath=path_2,
    CacheResultsInMemory=False,
    CacheSolveResults=False,
    RemoteDefinitionLocation="http://127.0.0.1:5000/timeseries_gen",
    RemoteSolveVersion=(0, 1, 0),
    ShowInput_Enabled=False,
    ShowInput_Path=False,
    SynchronousSolve=True)  # -> TimeSeries, DNIWeeklyAverage, DNIWeeklyPeak, DHIWeeklyAverage, DHIWeeklyPeak, DNIWeeklyMaxAvg, DNIWeeklyMinAvg, DHIWeeklyMaxAvg, DHIWeeklyMinAvg
split = SplitList(List=hops_2.TimeSeries, Index=Slider(168, range=0..1000))  # -> ListA, ListB
graph = QuickGraph(hops_2.DNIWeeklyMaxAvg, SortOrder=0)
graph_2 = QuickGraph(hops_2.DHIWeeklyMaxAvg, SortOrder=0)
graph_3 = QuickGraph(hops_2.DNIWeeklyAverage, SortOrder=0)
graph_4 = QuickGraph(hops_2.DHIWeeklyAverage, SortOrder=0)
graph_5 = QuickGraph(split.ListA, SortOrder=0)
graph_6 = QuickGraph(hops_2.DNIWeeklyMinAvg, SortOrder=0)
graph_7 = QuickGraph(hops_2.DHIWeeklyMinAvg, SortOrder=0)
graph_8 = QuickGraph(hops_2.DNIWeeklyPeak, SortOrder=0)
graph_9 = QuickGraph(hops_2.DHIWeeklyPeak, SortOrder=0)
# 30: Glazing ratio
# 16: near far
# 12: up down
number_slider = Slider(0, range=-5..5)
hops_3 = Hops(
    C_mu=panel_2,
    C_dim=Slider(17, range=0..100),
    Value=number_slider,
    CacheResultsInMemory=False,
    CacheSolveResults=False,
    RemoteDefinitionLocation="http://127.0.0.1:5000/wwr_traversal",
    RemoteSolveVersion=(0, 1, 0),
    ShowInput_Enabled=False,
    ShowInput_Path=False,
    SynchronousSolve=True)
image_resource_2 = ImageResource(hops_3)
