# Grasshopper definition unnamed.gh (Grasshopper 1.0.7)
# plug-ins: Hops

pt = Point(Point(-0.165929239, 1.440588257, 0))
path = FilePath("C:\Users\Philip\Documents\repos\SolarGAN\hops_test\space_shuttle.png")
cir = Circle(Plane=pt, Radius=Slider(11, range=0..20))
hops = Hops(
    Path=path,
    CacheResultsInMemory=True,
    CacheSolveResults=True,
    RemoteDefinitionLocation="http://127.0.0.1:5000/resnet",
    RemoteSolveVersion=(0, 1, 0),
    ShowInput_Enabled=False,
    ShowInput_Path=False,
    SynchronousSolve=True)
panel = Panel(hops)
hops_2 = Hops(
    Curve=cir,
    T=Slider(17, range=0..40),
    CacheResultsInMemory=False,
    CacheSolveResults=False,
    RemoteDefinitionLocation="http://127.0.0.1:5000/pointat",
    RemoteSolveVersion=(0, 1, 0),
    ShowInput_Enabled=False,
    ShowInput_Path=False,
    SynchronousSolve=True)
